# Grasshopper definition TestConnections.ghx (Grasshopper 1.0.7)
# plug-ins: HAL for Grasshopper

sph = Sphere(Base=PlaneXY(0, 0, 0), Radius=10)
sph_2 = Sphere(Base=PlaneXY(0, 0, 0), Radius=10)
mesh = MeshBrep(
    Brep=sph,
    Settings={GridMaxCount=0, GridMinCount=16, JaggedSeams=False, MaxEdgeLength=0, MinEdgeLength=0.0001, MinTolerance=0, Refine=True, RefineAngle=0, RelativeTolerance=0.65, SimplePlanes=True, Tolerance=0})
sph_3 = Sphere(Base=PlaneXY(0, 0, 0), Radius=10)
mesh_2 = MeshBrep(
    Brep=sph_2,
    Settings={GridMaxCount=0, GridMinCount=16, JaggedSeams=False, MaxEdgeLength=0, MinEdgeLength=0.0001, MinTolerance=0, Refine=True, RefineAngle=0, RelativeTolerance=0.65, SimplePlanes=True, Tolerance=0})
pt = ConstructPoint(XCoordinate=Slider(0, range=-1..1), YCoordinate=Slider(0, range=-1..1), ZCoordinate=Slider(1.6, range=-1..1.6))
pt_2 = ConstructPoint(XCoordinate=Slider(-0.5, range=-1..1), YCoordinate=Slider(0, range=-1..1), ZCoordinate=Slider(1.5, range=-1..1.5))
mesh_3 = MeshBrep(
    Brep=sph_3,
    Settings={GridMaxCount=0, GridMinCount=16, JaggedSeams=False, MaxEdgeLength=0, MinEdgeLength=0.0001, MinTolerance=0, Refine=True, RefineAngle=0, RelativeTolerance=0.65, SimplePlanes=True, Tolerance=0})
pt_3 = ConstructPoint(XCoordinate=Slider(0.5, range=-1..1), YCoordinate=Slider(0, range=-1..1), ZCoordinate=Slider(1.5, range=-1..1.5))
brep = Brep([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])
mesh_4 = MeshBrep(
    Brep=brep,
    Settings={GridMaxCount=0, GridMinCount=16, JaggedSeams=False, MaxEdgeLength=0, MinEdgeLength=0.0001, MinTolerance=0, Refine=True, RefineAngle=0, RelativeTolerance=0.65, SimplePlanes=True, Tolerance=0})
mjoin = MeshJoin(Meshes=mesh_4)
move = Move(Geometry=mjoin, Motion=Vector(0, 0, 100))  # -> Geometry, Transform
mesh_5 = Mesh(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)
sessionsettings = SessionSettings()
button = Button()
button_2 = Button()
units = ValueList({"m": 1, "cm": 100, "mm": 1000}, selected="cm")
multiplication = Multiplication(A=units, B=pt)
multiplication_2 = Multiplication(A=units, B=pt_2)
move_2 = Move(Geometry=mesh, Motion=multiplication)  # -> Geometry, Transform
move_3 = Move(Geometry=mesh_2, Motion=multiplication_2)  # -> Geometry, Transform
multiplication_3 = Multiplication(A=units, B=pt_3)
move_4 = Move(Geometry=mesh_3, Motion=multiplication_3)  # -> Geometry, Transform
merge = Merge(Data1=move_4.Geometry, Data2=move_3.Geometry, Data3=move_2.Geometry)
step = GhPythonScript(step=button, num_steps=Slider(265, range=0..1000))  # -> out, a
# ---------- step: Python ----------
__author__ = "Sam"
__version__ = "2021.05.20"

import rhinoscriptsyntax as rs
import scriptcontext as sc
from compas.rpc import Proxy

sc.sticky["proxy_scene"] = sc.sticky.get("proxy_scene", None)
sc.sticky["num_contacts"] = sc.sticky.get("num_contacts", 0)
proxy = sc.sticky["proxy_scene"]
print(proxy)

if not(num_steps):
    num_steps = 100
    
if step:
    if proxy:
        proxy.clear_contacts()
        proxy.step(int(num_steps))
        sc.sticky["num_contacts"] = proxy.display_contacts()
        
print(sc.sticky["num_contacts"])
# ---------- end step ----------
loadscene = LoadPlanningSceneFromMeshInputs(on=Button(), meshes=flatten(merge), scale=units, clear=Button(), concave=Toggle(False))  # -> collision_objects; inputs on: Boolean, meshes: list of Mesh
# ---------- loadscene: Python ----------
"""
On boolean true input, load a planning scene from mesh inputs
    Args:
        on: BOOL
        meshes: Mesh inputs as list
        scale: The system scaling factor (from robot model)
        clear: Clear the collsion objects
        concave: Load as concave mesh(es)
"""
        
ghenv.Component.Message = 'LoadScene v0.1'
        
import rhinoscriptsyntax as rs
import time
import scriptcontext as sc
from compas_rhino.geometry import RhinoMesh
import os
from compas.rpc import Proxy

sc.sticky["proxy_scene"] = sc.sticky.get("proxy_scene", None)

#connect_exists = getattr(sc.sticky["proxy_scene"], "is_connected", None)
#print(connect_exists)

if on: 
    if sc.sticky["proxy_scene"]:
        if sc.sticky["proxy_scene"].is_connected():
            proxy = sc.sticky["proxy_scene"]
        else:
            proxy = Proxy('vs068_pb.ghpython', python='C:\Users\Sam\Anaconda3\envs\project\python.exe')
            proxy.load_scene(load_floor=True)
            proxy.del_bot()
    else:
        proxy = Proxy('vs068_pb.ghpython', python='C:\Users\Sam\Anaconda3\envs\project\python.exe')
        proxy.load_scene(load_floor=True)
        proxy.del_bot()
        
    scaling_factor = 1/scale
    scale_arr = [scaling_factor, scaling_factor, scaling_factor]
    
    paths = []
    centres = []
    
    
    tmp_fldr = proxy.get_temp_obj_path()
    #print(tmp_fldr)
    for cnt, mesh in enumerate(meshes):
        if mesh == None:
            continue
        
        #paths.append(tmp_obj_path)
        
        scale_arr = [scaling_factor, scaling_factor, scaling_factor]
        centre = rs.MeshVolumeCentroid(mesh)
        centres.append(centre)
        
        pnt_centre = rs.CreatePoint(centre[0], centre[1], centre[2])
        vector_reversed = rs.CreateVector(rs.CreatePoint(-centre[0], -centre[1], -centre[2]))
        rs.ScaleObject(mesh, pnt_centre, scale_arr)
        rs.MoveObject(mesh, vector_reversed)

        tmp_obj_path = os.path.join(tmp_fldr, "{}.obj".format(cnt))
        print(tmp_obj_path)
        RhinoMesh.from_geometry(mesh).to_compas().to_obj(tmp_obj_path)

        paths.append(tmp_obj_path)
        proxy.load_mesh(tmp_obj_path, pos=list(centre*scaling_factor), concavity=concave, margin=1.0)
    
    proxy.clean_temp()
    sc.sticky["proxy_scene"] = proxy

if clear:
    if sc.sticky["proxy_scene"]:
        if sc.sticky["proxy_scene"].is_connected():
            sc.sticky["proxy_scene"].clear_scene()

if sc.sticky["proxy_scene"]:
    cobjs = sc.sticky["proxy_scene"].get_full_scene()
    
    collision_objects = [str(p) for p in cobjs]
# ---------- end loadscene ----------
python = GhPythonScript(check=Button())
# ---------- python: Python ----------
__author__ = "Sam"
__version__ = "2021.05.20"

import rhinoscriptsyntax as rs
import scriptcontext as sc
from compas.rpc import Proxy

sc.sticky["proxy_scene"] = sc.sticky.get("proxy_scene", None)

proxy = sc.sticky["proxy_scene"]

if check:
    if proxy:
        proxy.check_contacts()
        proxy.display_contacts()
# ---------- end python ----------
killscene = GhPythonScript(kill=Button())
# ---------- killscene: Python ----------
"""
On boolean true input, load a planning scene from mesh inputs
    Args:
        kill: Kill the proxy server and delete proxy sticky
"""

__author__ = "Sam"
__version__ = "2021.05.20"
ghenv.Component.Message = 'KillScene v0.1'

import rhinoscriptsyntax as rs
import scriptcontext as sc

st = sc.sticky

if kill:
    if st["proxy_scene"]:
        st["proxy_scene"].stop_server()
        st["proxy_scene"] = None
# ---------- end killscene ----------
python_2 = GhPythonScript(on=Button())  # -> out
# ---------- python_2: Python ----------
"""
Use quick_load_bot to load an arm (quickly!)
    Args:
        on: BOOL
"""
        
ghenv.Component.Message = 'LoadArm v0.1'
        
import rhinoscriptsyntax as rs
import time
        
if on:
    from compas.rpc import Proxy
        
    # pythonw prevents a window from opening
    with Proxy('vs068_pb.utils', python='C:\Users\Sam\Anaconda3\envs\project\python.exe') as proxy:
        botId, cid = proxy.quick_load_bot(1, quiet=False)
        proxy.loadFloor(cid)
        time.sleep(10)
        proxy.Disconnect()
# ---------- end python_2 ----------
testreach = LoadReachmap(on=Button(), preview=Toggle(False))  # -> data, X, Y, Z, R; inputs on: Boolean, preview: Boolean
# ---------- testreach: Python ----------
"""
On boolean true input, load the reach map data
    Args:
        on: BOOL
        preview: Display points
    Returns:
        data: The loaded data.
        X : X data
        Y : Y data
        Z : Z data
        R : Reach data
"""
        
ghenv.Component.Message = 'TestReach v1.0'
        
import scriptcontext as sc
import rhinoscriptsyntax as rs
import Rhino as r
import Rhino.Geometry as rg
import System.Drawing as sd
        
data = sc.sticky.get("data", None)
display = sc.sticky.get("display", r.Display.CustomDisplay(True))
        
if on:
    from compas.rpc import Proxy
        
    # pythonw prevents a window from opening
    with Proxy('vs068_pb.ghpython', python='C:\Users\Sam\Anaconda3\envs\project\pythonw.exe') as proxy:
        data = proxy.load_reach_data()
        sc.sticky["data"] = data
                
def column(A, i):
    return [row[int(i)] for row in A]
        
X = column(data, 0)
Y = column(data, 1)
Z = column(data, 2)
R = column(data, 3)
        
#pnts = [[rs.AddPoint([X[i], Y[i], Z[i]])] for i in range(len(X))]
#pnts = []
#for i in range(len(X)):
# pnts.append(rs.AddPoint([X[int(i)], Y[int(i)], Z[int(i)]]))
            
reach = R
        
if preview == True and preview != None:

    for i in range(len(X)):
        x = X[i]
        y = Y[i]
        z = Z[i]
        c = R[i]
                
        r_c = max(0,int(255*(0.5-c)/0.5))
        g_c = max(0,int(255*(c-0.5)/0.5))
        b_c = int(255*abs(0.5-abs(0.5-c))/0.5)*c
            
        color = sd.Color.FromArgb(r_c, g_c, b_c)
        Pt = rg.Point3d(100*x,100*y,100*z)
        display.AddPoint(Pt, color, r.Display.PointStyle.X, 2)
        sc.sticky["display"] = display
else:
    display.Clear()
    display.Dispose()
    del sc.sticky["display"]
# ---------- end testreach ----------
loaddemo = LoadVS068Demo(on=Button())  # -> pose; inputs on: Boolean
# ---------- loaddemo: Python ----------
"""
Loads the arm demo example. On exit, returns the final position of the EEF.
    Args:
        on: BOOL
    Returns:
        pose: Final EEF pose
"""
        
ghenv.Component.Message = 'LoadDemo v0.1'
        
import rhinoscriptsyntax as rs
import time
import scriptcontext as sc

pose = sc.sticky.get("pose", [0,0,0])
        
if on:
    from compas.rpc import Proxy
        
    # pythonw prevents a window from opening
    with Proxy('vs068_pb.ghpython', python='C:\Users\Sam\Anaconda3\envs\project\python.exe') as proxy:
        pose = proxy.load_demo()
        sc.sticky["pose"] = pose
# ---------- end loaddemo ----------
loadarmartist = LoadRobotArtist(scale_factor=units, load=Button())  # -> robot, visual; inputs load: Boolean
# ---------- loadarmartist: Python ----------
"""
On boolean true input, load the robot model to be displayed in Rhino
    Args:
        scale_factor: Amount to scale the robot model by
        load: BOOL
"""
        
import os
from scriptcontext import sticky as st

import compas

from compas_ghpython.artists import RobotModelArtist
from compas.robots import LocalPackageMeshLoader
from compas.robots import RobotModel
from compas_fab.robots import RobotSemantics
import compas_fab
from compas_fab.robots import Robot as RobotClass

ghenv.Component.Message = 'LoadArmArtist v0.1'
compas.PRECISION = '12f'

# store robot in component
guid = str(ghenv.Component.InstanceGuid)
robot_key = "robot_" + guid
visual_key = "visual_" + guid

if robot_key not in st:
    st[robot_key] = None

if visual_key not in st:
    st[visual_key] = None

if load:
    os.chdir(r"C:\Users\Sam\OneDrive - University of Leeds\_PhD\ROS\vs068_pb\resources")
    urdf_filename = r'C:\Users\Sam\OneDrive - University of Leeds\_PhD\ROS\vs068_pb\resources\vs068_with_gripper_pybullet.urdf'
    #urdf_filename = compas_fab.get('vs068/vs068_description/urdf/vs068.urdf')
    #srdf_filename = compas_fab.get('vs068/vs068_moveit_config/config/vs068.srdf')
    
    model = RobotModel.from_urdf_file(urdf_filename)
    #semantics = RobotSemantics.from_srdf_file(srdf_filename, model)
    
    loader = LocalPackageMeshLoader(compas_fab.get('vs068'), 'vs068_description')
    model.load_geometry(loader)
    
    robot = RobotClass(model)
    
    robot.artist = RobotModelArtist(robot.model)
    st[robot_key] = robot
    robot.scale(scale_factor)
    st[visual_key] = robot.draw()


robot = st[robot_key]
#visual = robot.draw_visual()
# ---------- end loadarmartist ----------
step_2 = GhPythonScript(x=Button(), robot=loadarmartist.robot)  # -> out, visual
# ---------- step_2: Python ----------
__author__ = "Sam"
__version__ = "2021.05.20"

import rhinoscriptsyntax as rs
import scriptcontext as sc
from compas_fab.robots import Configuration
from compas.rpc import Proxy

sc.sticky["proxy_scene"] = sc.sticky.get("proxy_scene", None)
proxy = sc.sticky["proxy_scene"]
sc.sticky["joint_vals"] = sc.sticky.get("joint_vals", [0.0, 0.0, 0.0, 0.0, 0.0, 0.0, 0.0, 0.0])

def set_visual():
    q_pos = [float(q) for q in sc.sticky["joint_vals"]]
    joint_types = robot.get_configurable_joint_types()
    full_configuration = Configuration(q_pos, joint_types)
    robot.update(full_configuration, visual=True)
    visual = robot.draw_visual()


print(proxy)
if x:
    if proxy:
        for n in range(10):
            proxy.step(10)
            sc.sticky["joint_vals"] = proxy.get_joint_positions()
            set_visual()

set_visual()
# ---------- end step_2 ----------
clearpose = ClearPoseData(on=Button())  # inputs on: Boolean
# ---------- clearpose: Python ----------
"""
Resets the stickied EEF pose and recomputes the solution
    Args:
        on: BOOL
"""

__author__ = "Sam"
__version__ = "2021.05.12"

import rhinoscriptsyntax as rs
import scriptcontext as sc
import Grasshopper
from Grasshopper.Kernel import GH_Param, GH_Convert, Parameters

ghenv.Component.Message = 'ClearPose v0.1'

def ghSolutionRecompute():
    """ Recomputes the Grasshopper solution (ala pressing F5) """
    
    def expireAllComponentsButThis(e):
        for obj in ghenv.Component.OnPingDocument().Objects:
            if not obj.InstanceGuid == ghenv.Component.InstanceGuid:
                obj.ExpireSolution(False)
                
    ghenv.Component.OnPingDocument().ScheduleSolution(1000,expireAllComponentsButThis)



if on:
    sc.sticky["pose"] = [0,0,0]
    ghSolutionRecompute()
# ---------- end clearpose ----------
button_3 = Button()
python_3 = GhPythonScript(getJointVals=button, x=button_3)  # -> q_pos
# ---------- python_3: Python ----------
__author__ = "Sam"
__version__ = "2021.05.20"

import rhinoscriptsyntax as rs
import scriptcontext as sc

sc.sticky["proxy_scene"] = sc.sticky.get("proxy_scene", None)
proxy = sc.sticky["proxy_scene"]
sc.sticky["joint_vals"] = sc.sticky.get("joint_vals", [0.0, 0.0, 0.0, 0.0, 0.0, 0.0, 0.0, 0.0])
if getJointVals:
    if proxy:
        sc.sticky["joint_vals"] = proxy.get_joint_positions()
        
q_pos = sc.sticky["joint_vals"]
# ---------- end python_3 ----------
panel = Panel(step.out)
merge_2 = Merge(
    Data1=Slider(-1.949, range=-3.141..3.141),
    Data2=Slider(1.957, range=-3.141..3.141),
    Data3=Slider(0, range=-3.141..3.141),
    Data4=Slider(0, range=-3.141..3.141),
    Data5=Slider(0, range=-3.141..3.141),
    Data6=Slider(0, range=-3.141..3.141),
    Data7=Slider(0.02, range=0..0.14),
    Data8=Slider(0.02, range=0..0.14))
gradient = Gradient(
    LowerLimit=0,
    UpperLimit=1,
    Parameter=testreach.R,
    stops=[0: RGBA(56, 18, 128, 70), 0.0128: RGBA(252, 18, 0, 74), 0.28: RGBA(99, 24, 151, 99), 0.998: RGBA(0, 255, 0, 100), 1: RGBA(220, 0, 40, 102)])
smaller = SmallerThan(FirstNumber=testreach.Z, SecondNumber=Slider(0.9, range=0..1.5))  # -> SmallerThan, OrEqualTo
pt_4 = ConstructPoint(XCoordinate=testreach.X, YCoordinate=testreach.Y, ZCoordinate=testreach.Z)
panel_2 = Panel(python_3)
panel_3 = Panel(loadscene)
panel_4 = Panel(loaddemo)
python_4 = GhPythonScript(q_vals=merge_2, set=button_3)  # inputs q_vals: list
# ---------- python_4: Python ----------
__author__ = "Sam"
__version__ = "2021.05.20"

import rhinoscriptsyntax as rs
import rhinoscriptsyntax as rs
import scriptcontext as sc

sc.sticky["proxy_scene"] = sc.sticky.get("proxy_scene", None)
proxy = sc.sticky["proxy_scene"]

if set:
    proxy.set_joint_positions(q_vals)

sc.sticky["joint_vals"] = q_vals
# ---------- end python_4 ----------
cull = CullPattern(List=pt_4, CullPattern=smaller.OrEqualTo)
python_5 = GhPythonScript(robot=loadarmartist.robot, q_pos=panel_2)  # -> out, a; inputs q_pos: list
# ---------- python_5: Python ----------
__author__ = "Sam"
__version__ = "2021.05.20"

import rhinoscriptsyntax as rs
from compas_fab.robots import Configuration
#q_pos = q_pos[:-1] #Mimic joint?
q_pos = [float(q) for q in q_pos]

print(q_pos)
joint_types = robot.get_configurable_joint_types()
print(joint_types)
full_configuration = Configuration(q_pos, joint_types)
print(full_configuration)
robot.update(full_configuration, visual=True)

a = robot.draw_visual()
# ---------- end python_5 ----------
scale = Scale(Geometry=cull, Center=Point(0, 0, 0), Factor=units)  # -> Geometry, Transform
cull_2 = CullPattern(List=gradient, CullPattern=smaller.OrEqualTo)
preview = CustomPreview(Geometry=scale.Geometry, Material=cull_2)
